# Grasshopper definition Execute_Function.gh (Grasshopper 0.9.76)
# plug-ins: gHowl

# ---- group: EXAMPLE 2 : SEND AND RECEIVE A COMPUTED ANSWER
txt = Text(Slider(61.3, range=0..100))
udp = UDPReceiver(Address="127.0.0.1", Port="1110", Pattern="0")  # -> Info, Data
udp_2 = UDPSender(Address="127.0.0.1", Port="9997", Pattern=0, Data=txt)
panel = Panel(udp.Info)
msg = Panel(udp.Data)

# ----
panel_2 = Panel(udp_2)
