# Grasshopper definition Mirror.gh (Grasshopper 0.9.76)
# plug-ins: gHowl

# ---- group: EXAMPLE 1 : SEND AND RECEIVE SIMPLE MESSAGES
txt = Text(Slider(65.6, range=0..100))
udp = UDPReceiver(Address="127.0.0.1", Port="1110", Pattern="0")  # -> Info, Data
udp_2 = UDPSender(Address="127.0.0.1", Port="9997", Pattern=0, Data=txt)
panel = Panel(udp.Info)
panel_2 = Panel(udp_2)
msg = Panel(udp.Data)
