# Grasshopper definition Share_Big_Data.gh (Grasshopper 0.9.76)
# plug-ins: gHowl

# ---- group: Membrane Shape
rectangle = Rectangle(Plane=PlaneXY(0, 0, 0), XSize=Slider(50, range=10..100), YSize=Slider(50, range=10..100), Radius=0)  # -> Rectangle, Length
preview = CustomPreview(Geometry=rectangle.Rectangle, Shader=ColourSwatch(SwatchColor=RGB(255, 0, 0)))

# ---- group: UV Mesh
sdivide = DivideSurface(Surface=rectangle.Rectangle, UCount=Slider(20, range=4..100), VCount=Slider(20, range=4..100))  # -> Points, Normals, Parameters
flip = FlipMatrix(Data=sdivide.Points)  # -> simplify(Data)

# ---- group: Format Mesh String
pdecon = Deconstruct(Point=flip)  # -> XComponent, YComponent, ZComponent
join = TextJoin(Text=pdecon.YComponent, Join=",")  # -> flatten(Result)
join_2 = TextJoin(Text=pdecon.XComponent, Join=",")  # -> flatten(Result)
join_3 = TextJoin(Text=join, Join=";")
join_4 = TextJoin(Text=join_2, Join=";")

# ---- group: Material Properties
gxy = Slider(8, range=0..100)
ex = Slider(50, range=0..100)
ey = Slider(34, range=0..100)
nuxy = Slider(0.49, range=-0.5..1)
join_5 = TextJoin(Text=[ex, ey, gxy, nuxy], Join=",")

# ---- group: Apply Force
force_application_point = Slider(1, range=0..1)
fx = Slider(9, range=-50..50)
fy = Slider(-1, range=-50..50)
lng = ListLength(List=flatten(flip))  # -> expr("x-1", Length)
multiplication = Multiplication(A=lng, B=force_application_point)
X = UnitX(Factor=fx)
Y = UnitY(Factor=fy)
round = Round(Number=multiplication)  # -> Nearest, Floor, Ceiling
addition = Addition(A=X, B=Y)
item = ListItem(List=flatten(flip), Index=round.Nearest, Wrap=True)
swatch = ColourSwatch(SwatchColor=RGB(255, 0, 0))
line = LineSDL(Start=item, Direction=addition, Length=addition)
end = EndPoints(Curve=line)  # -> Start, End
join_6 = TextJoin(Text=[round.Nearest, fx, fy], Join=",")
vdisex = VectorDisplayEx(Point=item, Vector=line, Colour=swatch, Width=1)
tag = TextTag(Location=end.End, Text="Force", Colour=swatch)

# ---- group: FILE INFOS
working_directory = Panel("C:\Users\pierre.margerit\Documents\MATLAB\THESE\+WORK_IN_PROGRESS\Exemples_UDP_Matlab_GH\")
input_file_name = Panel("INPUT.txt")
output_file_name = Panel("OUTPUT.txt")
concat = Concatenate(FragmentA=working_directory, FragmentB=input_file_name)
concat_2 = Concatenate(FragmentA=working_directory, FragmentB=output_file_name)

# ----
join_7 = TextJoin(Text=[join_4, join_3, join_6, join_5], Join="-----")
writestrtofile = CSharpScript(StringToWrite=join_7, FilePath=concat)  # -> out, A; inputs StringToWrite: String, FilePath: String
# ---------- writestrtofile: C# ----------
    System.IO.File.WriteAllText(FilePath, StringToWrite);
    //System.Threading.Thread.Sleep(100);
    A = true;;
# ---------- end writestrtofile ----------

# ---- group: Send Trigger Message
# v
#             v
#             v
# 
# MATLAB SCRIPT
# 
#             v
#             v
#             v
txt = Text(writestrtofile.A)
udp = UDPSender(Address="127.0.0.1", Port="9997", Pattern=0, Data=txt)
panel = Panel(udp)

# ---- group: Receive Answer Message
udp_2 = UDPReceiver(Address="127.0.0.1", Port="1110", Pattern="0")  # -> Info, Data
panel_2 = Panel(udp_2.Info)
bool = Boolean(udp_2.Data)

# ---- group: LOAD OUTPUTS
filter = StreamFilter(Gate=bool, Stream1=concat_2)
readstrfromfile = CSharpScript(FilePath=filter)  # -> out, simplify(graft(lines)); inputs FilePath: String
# ---------- readstrfromfile: C# ----------
    lines = System.IO.File.ReadAllLines(FilePath);
    //System.Threading.Thread.Sleep(100);
# ---------- end readstrfromfile ----------
str2mat = CSharpScript(strMat=readstrfromfile.lines)  # -> out, simplify(Matrix); inputs strMat: tree of String
# ---------- str2mat: C# ----------
    DataTree<string> MAT = new DataTree<string>();
    foreach(GH_Path path in strMat.Paths){
      string str = strMat.Branch(path)[0];
      str = str.Replace("[", string.Empty);
      str = str.Replace("]", string.Empty);
      string[] lines = str.Split(';');
      int branch = 0;
      foreach (string line in lines) {
        string[] content = line.Split(' ');
        foreach (string val in content) {
          MAT.Add(val,path.AppendElement(branch));
        }
        branch++;
      } 
    }
    Matrix = MAT;
# ---------- end str2mat ----------

# ---- group: SPLIT OUTPUT
tstat = TreeStatistics(Tree=str2mat.Matrix)  # -> flatten(Paths), Length, Count
dpath = DeconstructPath(Branch=tstat.Paths)  # -> simplify(Indices)
item_2 = ListItem(List=dpath, Index=0, Wrap=True)  # -> flatten(Item)
cull = CullPattern(List=tstat.Paths, CullPattern=invert(item_2))
cull_2 = CullPattern(List=tstat.Paths, CullPattern=item_2)
branch = TreeBranch(Tree=str2mat.Matrix, Path=cull_2, MaintainPaths=True)  # -> simplify(Branch)
branch_2 = TreeBranch(Tree=str2mat.Matrix, Path=cull, MaintainPaths=True)  # -> simplify(Branch)

# ---- group: SCALING FACTOR
scale_power = Slider(3.07, range=-10..10)
pow = Power(_10=10, B=scale_power)
multiplication_2 = Multiplication(A=branch_2, B=pow)
multiplication_3 = Multiplication(A=branch, B=pow)

# ---- group: DEFORMED SHAPE PREVIEW
addition_2 = Addition(XX=pdecon.XComponent, U1=multiplication_2)
addition_3 = Addition(YY=pdecon.YComponent, U2=multiplication_3)
pt = ConstructPoint(XCoordinate=addition_2, YCoordinate=addition_3, ZCoordinate=0)
flip_2 = FlipMatrix(Data=pt)
pline = PolyLine(Vertices=pt, Closed=False)
pline_2 = PolyLine(Vertices=flip_2, Closed=False)
preview_2 = CustomPreview(Geometry=[pline, pline_2], Shader=ColourSwatch(SwatchColor=RGB(0, 55, 255)))
